# Grasshopper definition gaussian-planting.gh (Grasshopper 1.0.8)
# Copyright: GNU General Public License 3.0

point = Point(Point(0, 0, 0))

# ---- group: right click to set point cloud
# gaussian planting
# set point clouds
# tree
point_cloud = PointCloud()

# ----
# scatter trees
# set type hint for points to list
boolean_toggle = BooleanToggle(False)
point_cloud_2 = PointCloud(point_cloud)
count = Slider(3, range=0..100)
deviation = Slider(2, range=0..10)
gaussian = Script(Run=boolean_toggle, Cloud=point_cloud_2, Points=point, Count=count, Deviation=deviation)  # -> Out, Points, Clouds; inputs Run: Boolean, Cloud: PointCloud, Points: list of Point3d, Count: Int32, Deviation: Double
# ---------- gaussian: Python ----------
"""Gaussian Planting"""
#! python 3

# requirements: numpy
import numpy as np
import Rhino
import rhinoscriptsyntax as rs
import scriptcontext as sc
sc.doc = Rhino.RhinoDoc.ActiveDoc

if Run:

    # create empty array
    coordinates = np.empty(shape=[0, 3])

    # loop
    for point in Points:

        # instantiate random number generator
        rng = np.random.default_rng()

        # generate random x, y, and z values
        n = int(Count)
        sigma = float(Deviation) # standard deviation
        x = rng.normal(point[0], sigma, n)
        y = rng.normal(point[1], sigma, n)
        z = np.zeros(n)

        # interweave coordinates
        xyz = np.column_stack((x, y, z))

        # append arrays
        coordinates = np.append(coordinates, xyz, axis=0)

    # create points
    Points = rs.AddPoints(coordinates)

    # loop
    Clouds = []
    for point in Points:

        # set variables
        angle = rng.uniform(0.0, 360.0)
        s = rng.uniform(0.5, 1.0)
        scaling = (s, s, s)

        # transform
        transform = rs.CopyObject(Cloud, point)
        transform = rs.RotateObject(transform, point, angle)
        transform = rs.ScaleObject(transform, point, scaling)
        Clouds.append(transform)
# ---------- end gaussian ----------
point_cloud_3 = PointCloud(gaussian.Clouds)
point_2 = Point(gaussian.Points)

# ---- group: right click to set point cloud
# fern
point_cloud_4 = PointCloud()

# ----
# scatter understory
# set type hint for points to list
boolean_toggle_2 = BooleanToggle(False)
point_cloud_5 = PointCloud(point_cloud_4)
point_3 = Point(point_2)
count_2 = Slider(36, range=0..100)
deviation_2 = Slider(1.2, range=0..10)
gaussian_2 = Script(Run=boolean_toggle_2, Cloud=point_cloud_5, Points=point_3, Count=count_2, Deviation=deviation_2)  # -> Out, Points, Clouds; inputs Run: Boolean, Cloud: PointCloud, Points: list of Point3d, Count: Int32, Deviation: Double
# ---------- gaussian_2: Python ----------
"""Gaussian Planting"""
#! python 3

# requirements: numpy
import numpy as np
import rhinoscriptsyntax as rs
import Rhino
import scriptcontext as sc
sc.doc = Rhino.RhinoDoc.ActiveDoc

if Run:

    # create empty array
    coordinates = np.empty(shape=[0, 3])

    # loop
    for point in Points:

        # instantiate random number generator
        rng = np.random.default_rng()

        # generate random x, y, and z values
        n = int(Count)
        sigma = float(Deviation) # standard deviation
        x = rng.normal(point[0], sigma, n)
        y = rng.normal(point[1], sigma, n)
        z = np.zeros(n)

        # interweave coordinates
        xyz = np.column_stack((x, y, z))

        # append arrays
        coordinates = np.append(coordinates, xyz, axis=0)

    # create points
    Points = rs.AddPoints(coordinates)

    # loop
    Clouds = []
    for point in Points:

        # set variables
        angle = rng.uniform(0.0, 360.0)
        s = rng.uniform(0.5, 1.0)
        scaling = (s, s, s)

        # transform
        transform = rs.CopyObject(Cloud, point)
        transform = rs.RotateObject(transform, point, angle)
        transform = rs.ScaleObject(transform, point, scaling)
        Clouds.append(transform)
# ---------- end gaussian_2 ----------
point_cloud_6 = PointCloud(gaussian_2.Clouds)
