# Grasshopper definition hello-world.gh (Grasshopper 1.0.7)
# plug-ins: RhinoCodePluginGH

# ----
# hello world
boolean_toggle = BooleanToggle(True)
hello_world = Script(Run=boolean_toggle)  # -> Out
# ---------- hello_world: Python ----------
"""Hello World"""
#! python 3

if Run:
    print("Hello World!")
# ---------- end hello_world ----------
panel = Panel(hello_world)
