# Grasshopper definition random-points.gh (Grasshopper 1.0.7)
# plug-ins: RhinoCodePluginGH

# ----
# random points
boolean_toggle = BooleanToggle(True)
count = Slider(100, range=0..100)
random_points = Script(Run=boolean_toggle, Count=count)  # -> Out, Cloud
# ---------- random_points: Python ----------
"""Random Points"""
#! python 3

# requirements: numpy
import numpy as np
import Rhino
import rhinoscriptsyntax as rs
import scriptcontext as sc
sc.doc = Rhino.RhinoDoc.ActiveDoc

if Run:

    # instantiate random number generator
    rng = np.random.default_rng()

    # generate random x, y, and z values
    n = int(Count)
    x = rng.random(n)
    y = rng.random(n)
    z = rng.random(n)

    # set points from coordinates
    points = np.column_stack((x, y, z))

    # generate point cloud
    Cloud = rs.AddPointCloud(points)

else:
    pass
# ---------- end random_points ----------
point_cloud = PointCloud(random_points.Cloud)
