# Grasshopper definition random.gh (Grasshopper 1.0.7)
# Copyright: GNU General Public License 3.0

# ---- group: random list
# randomness
# random list
range = Slider(1, range=0..10)
number = Slider(10, range=0..10)
# random grid
seed = Slider(0, range=0..1000)
# right click to set integer mode
random = Random(Range=range, Number=number, Seed=seed, Integers=True)
panel = Panel(random)

# ---- group: colored grid
cellsize = Slider(1, range=0..10)
extent_x = Slider(10, range=0..100)
extent_y = Slider(10, range=0..100)
# random matrix
seed_2 = Slider(0, range=0..1000)
square = Square(Plane=PlaneXY(0, 0, 0), Size=cellsize, ExtentX=extent_x, ExtentY=extent_y)  # -> flatten(Cells), Points
list_length = ListLength(List=square.Cells)
random_2 = Random(Range=Domain(0, 1), Number=list_length, Seed=seed_2, Integers=False)
boundary_surfaces = BoundarySurfaces(Edges=square.Cells)
gradient = Gradient(
    LowerLimit=0,
    UpperLimit=1,
    Parameter=random_2,
    stops=[0: RGB(68, 1, 84), 0.167: RGB(68, 57, 131), 0.334: RGB(49, 104, 142), 0.501: RGB(33, 145, 140), 0.668: RGB(53, 183, 121), 0.835: RGB(144, 215, 67), 1: RGB(253, 231, 37)])
custom_preview = CustomPreview(Geometry=boundary_surfaces, Material=gradient)

# ---- group: 2D matrix
extent_x_2 = Number(extent_x)
extent_y_2 = Number(extent_y)
number_2 = Number(random_2)
construct_matrix = ConstructMatrix(Rows=extent_x_2, Columns=extent_y_2, Values=number_2)
display_matrix = DisplayMatrix(construct_matrix, Digits=1)
