# Grasshopper definition cellular-rockery.gh (Grasshopper 1.0.7)
# Copyright: GNU General Public License 3.0

# ---- group: voronoi diagram
# cellular rockery
# square region
# voronoi diagram
count = Slider(100, range=0..1000)
seed = Slider(0, range=0..1000)
# extrusion
xy = Slider(100, range=0..1000)
rectangle = Rectangle(Plane=PlaneXY(0, 0, 0), XSize=xy, YSize=xy, Radius=0)  # -> Rectangle, Length
populate_2d = Populate2D(Region=rectangle.Rectangle, Count=count, Seed=seed)
voronoi = Voronoi(Points=populate_2d, Boundary=rectangle.Rectangle, BruteForceOverride=False)
curve = Curve(voronoi)

# ---- group: extrusion
curve_2 = Curve(curve)
# random colors
panel = Panel("2 To 10")
area = Area(Geometry=curve_2)  # -> Area, Centroid
bounds = Bounds(Numbers=area.Area)
remap_numbers = RemapNumbers(Value=area.Area, Source=bounds, Target=panel)  # -> Mapped, Clipped
boundary_surfaces = BoundarySurfaces(Edges=curve_2)
unit_z = UnitZ(Factor=remap_numbers.Mapped)
extrude = Extrude(Base=boundary_surfaces, Direction=unit_z)
brep = Brep(extrude)

# ---- group: random colors
brep_2 = Brep(brep)
# circular region
area_2 = Number(area.Area)
bounds_2 = Bounds(Numbers=area_2)
remap_numbers_2 = RemapNumbers(Value=area_2, Source=bounds_2, Target=Domain(0, 1))  # -> Mapped, Clipped
gradient = Gradient(LowerLimit=0, UpperLimit=1, Parameter=remap_numbers_2.Mapped, stops=[0: RGB(224, 224, 224), 1: RGB(64, 64, 64)])
custom_preview = CustomPreview(Geometry=brep_2, Material=gradient)

# ---- group: voronoi diagram
# voronoi diagram
radius = Slider(100, range=0..1000)
count_2 = Slider(100, range=0..1000)
seed_2 = Slider(0, range=0..1000)
circle = Circle(Plane=PlaneXY(0, 0, 0), Radius=radius)
boundary_surfaces_2 = BoundarySurfaces(Edges=circle)
populate_geometry = PopulateGeometry(Geometry=boundary_surfaces_2, Count=count_2, Seed=seed_2)
voronoi_2 = Voronoi(Points=populate_geometry, BruteForceOverride=False)
region_intersection = RegionIntersection(CurvesA=voronoi_2, CurvesB=circle)
curve_3 = Curve(region_intersection)

# ---- group: culling pattern
# culling pattern
curve_4 = Curve(curve_3)
# extrusion
minimum = Slider(250, range=0..1000)
area_3 = Area(Geometry=curve_4)  # -> Area, Centroid
larger_than = LargerThan(FirstNumber=area_3.Area, SecondNumber=minimum)  # -> LargerThan, OrEqualTo
cull_pattern = CullPattern(List=curve_4, CullPattern=larger_than.LargerThan)
curve_5 = Curve(cull_pattern)

# ---- group: extrusion
curve_6 = Curve(curve_5)
# random colors
panel_2 = Panel("2 To 20")
area_4 = Area(Geometry=curve_6)  # -> Area, Centroid
bounds_3 = Bounds(Numbers=area_4.Area)
remap_numbers_3 = RemapNumbers(Value=area_4.Area, Source=bounds_3, Target=panel_2)  # -> Mapped, Clipped
boundary_surfaces_3 = BoundarySurfaces(Edges=curve_6)
unit_z_2 = UnitZ(Factor=remap_numbers_3.Mapped)
extrude_2 = Extrude(Base=boundary_surfaces_3, Direction=unit_z_2)
brep_3 = Brep(extrude_2)

# ---- group: random colors
brep_4 = Brep(brep_3)
area_5 = Number(area_4.Area)
bounds_4 = Bounds(Numbers=area_5)
remap_numbers_4 = RemapNumbers(Value=area_5, Source=bounds_4, Target=Domain(0, 1))  # -> Mapped, Clipped
gradient_2 = Gradient(LowerLimit=0, UpperLimit=1, Parameter=remap_numbers_4.Mapped, stops=[0: RGB(224, 224, 224), 1: RGB(64, 64, 64)])
custom_preview_2 = CustomPreview(Geometry=brep_4, Material=gradient_2)
