# Grasshopper definition gaussian-planting.gh (Grasshopper 1.0.8)
# Copyright: GNU General Public License 3.0

point = Point(Point(0, 0, 0))

# ---- group: right click to set point cloud
# gaussian planting
# set point clouds
# tree
point_cloud = PointCloud(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)

# ----
# scatter trees
boolean_toggle = BooleanToggle(True)
point_cloud_2 = PointCloud(point_cloud)
count = Slider(3, range=0..100)
deviation = Slider(2, range=0..10)
gaussian = Script(Run=boolean_toggle, Cloud=point_cloud_2, Points=point, Count=count, Deviation=deviation)  # -> Out, Points, Clouds; inputs Run: Boolean, Cloud: PointCloud, Points: list of Point3d, Count: Int32, Deviation: Double
# ---------- gaussian: Python ----------
"""Gaussian Planting"""
#! python 3

# requirements: numpy
import Rhino.Collections as rc
import Rhino.Geometry as rg
import numpy as np
import math

if Run:

    # create empty sets
    points = rc.Point3dList()
    coordinates = np.empty(shape=[0, 3])
    Clouds = []

    # generate gaussian distribution of points
    for point in Points:

        # instantiate random number generator
        rng = np.random.default_rng()

        # generate random x, y, and z values
        n = int(Count)
        sigma = float(Deviation) # standard deviation
        x = rng.normal(point[0], sigma, n)
        y = rng.normal(point[1], sigma, n)
        z = np.zeros(n)

        # interweave coordinates
        xyz = np.column_stack((x, y, z))

        # add points to list
        xyz = xyz.tolist()
        for coordinate in xyz:
            point = rg.Point3d(
                coordinate[0],
                coordinate[1],
                coordinate[2]
                )
            points.AddRange([point])

    # transform point clouds
    Points = points
    for point in Points:

        # set variables
        vector = rg.Vector3d(0, 0, 1)
        angle = math.pi / rng.uniform(0.0, 360.0)
        scaling = rng.uniform(0.5, 1.0)

        # transform
        transform = Cloud.DuplicateShallow()
        transform.Rotate(angle, vector, point)
        transform.Scale(scaling)
        transform.Translate(point)
        Clouds.append(transform)
# ---------- end gaussian ----------
point_cloud_3 = PointCloud(gaussian.Clouds)
point_2 = Point(gaussian.Points)

# ---- group: right click to set point cloud
# fern
point_cloud_4 = PointCloud(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)

# ----
# scatter understory
boolean_toggle_2 = BooleanToggle(True)
point_cloud_5 = PointCloud(point_cloud_4)
point_3 = Point(point_2)
count_2 = Slider(36, range=0..100)
deviation_2 = Slider(1.2, range=0..10)
gaussian_2 = Script(Run=boolean_toggle_2, Cloud=point_cloud_5, Points=point_3, Count=count_2, Deviation=deviation_2)  # -> Out, Points, Clouds; inputs Run: Boolean, Cloud: PointCloud, Points: list of Point3d, Count: Int32, Deviation: Double; same code as gaussian
point_cloud_6 = PointCloud(gaussian_2.Clouds)
