# Grasshopper definition waves.gh (Grasshopper 1.0.7)
# Copyright: GNU General Public License 3.0

# ---- group: sine wave
# waves
# sine wave
t = Slider(2, range=0..10)
pi = Pi(Factor=t)
range = Range(Domain=pi, Steps="200")
sine = Sine(Value=range)
construct_point = ConstructPoint(XCoordinate=range, YCoordinate=sine, ZCoordinate=0)
interpolate = Interpolate(Vertices=construct_point, Degree=3, Periodic=False, KnotStyle=1)  # -> Curve, Length, Domain
curve = Curve(interpolate.Curve)

# ---- group: cosine wave
# cosine wave
t_2 = Slider(2, range=0..10)
pi_2 = Pi(Factor=t_2)
range_2 = Range(Domain=pi_2, Steps="200")
cosine = Cosine(Value=range_2)
construct_point_2 = ConstructPoint(XCoordinate=range_2, YCoordinate=cosine, ZCoordinate=0)
interpolate_2 = Interpolate(Vertices=construct_point_2, Degree=3, Periodic=False, KnotStyle=1)  # -> Curve, Length, Domain
curve_2 = Curve(interpolate_2.Curve)

# ---- group: unit circle
# unit circle
t_3 = Slider(2, range=0..10)
pi_3 = Pi(Factor=t_3)
range_3 = Range(Domain=pi_3, Steps="200")
sine_2 = Sine(Value=range_3)
cosine_2 = Cosine(Value=range_3)
construct_point_3 = ConstructPoint(XCoordinate=sine_2, YCoordinate=cosine_2, ZCoordinate=0)
interpolate_3 = Interpolate(Vertices=construct_point_3, Degree=3, Periodic=False, KnotStyle=1)  # -> Curve, Length, Domain
curve_3 = Curve(interpolate_3.Curve)

# ---- group: expression
# expression
t_4 = Slider(2, range=0..10)
pi_4 = Pi(Factor=t_4)
range_4 = Range(Domain=pi_4, Steps="200")
expression = Expression(x=range_4, Expression="sin(x)")
construct_point_4 = ConstructPoint(XCoordinate=range_4, YCoordinate=expression, ZCoordinate=0)
interpolate_4 = Interpolate(Vertices=construct_point_4, Degree=3, Periodic=False, KnotStyle=1)  # -> Curve, Length, Domain
curve_4 = Curve(interpolate_4.Curve)

# ---- group: sinusoidal wave
# transformations
# sinusoidal wave
t_5 = Slider(2, range=0..10)
b = Slider(1, range=0..6)
c = Slider(0, range=0..6)
a = Slider(2, range=0..6)
d = Slider(0, range=0..6)
pi_5 = Pi(Factor=t_5)
range_5 = Range(Domain=pi_5, Steps="200")
multiplication = Multiplication(A=range_5, B=b)
subtraction = Subtraction(A=multiplication, B=c)
sine_3 = Sine(Value=subtraction)
multiplication_2 = Multiplication(A=sine_3, B=a)
addition = Addition(A=multiplication_2, B=d)
construct_point_5 = ConstructPoint(XCoordinate=range_5, YCoordinate=addition, ZCoordinate=0)
interpolate_5 = Interpolate(Vertices=construct_point_5, Degree=3, Periodic=False, KnotStyle=1)  # -> Curve, Length, Domain
curve_5 = Curve(interpolate_5.Curve)

# ---- group: sinusoidal wave expression
# sinusoidal wave expression
t_6 = Slider(2, range=0..10)
a_2 = Slider(2, range=0..6)
b_2 = Slider(1, range=0..6)
c_2 = Slider(0, range=0..6)
d_2 = Slider(0, range=0..6)
pi_6 = Pi(Factor=t_6)
range_6 = Range(Domain=pi_6, Steps="200")
expression_2 = Expression(x=range_6, a=a_2, b=b_2, c=c_2, d=d_2, Expression="a*sin(b*x-c)+d")
construct_point_6 = ConstructPoint(XCoordinate=range_6, YCoordinate=expression_2, ZCoordinate=0)
interpolate_6 = Interpolate(Vertices=construct_point_6, Degree=3, Periodic=False, KnotStyle=1)  # -> Curve, Length, Domain
curve_6 = Curve(interpolate_6.Curve)

# ---- group: amplitude
# amplitude
t_7 = Slider(2, range=0..10)
a_3 = Slider(2, range=0..10)
pi_7 = Pi(Factor=t_7)
range_7 = Range(Domain=pi_7, Steps="200")
sine_4 = Sine(Value=range_7)
multiplication_3 = Multiplication(A=sine_4, B=a_3)
construct_point_7 = ConstructPoint(XCoordinate=range_7, YCoordinate=multiplication_3, ZCoordinate=0)
interpolate_7 = Interpolate(Vertices=construct_point_7, Degree=3, Periodic=False, KnotStyle=1)  # -> Curve, Length, Domain
curve_7 = Curve(interpolate_7.Curve)

# ---- group: modulation
# modulation
t_8 = Slider(2, range=0..10)
b_3 = Slider(2, range=0..10)
pi_8 = Pi(Factor=t_8)
range_8 = Range(Domain=pi_8, Steps="200")
multiplication_4 = Multiplication(A=range_8, B=b_3)
sine_5 = Sine(Value=multiplication_4)
construct_point_8 = ConstructPoint(XCoordinate=range_8, YCoordinate=sine_5, ZCoordinate=0)
interpolate_8 = Interpolate(Vertices=construct_point_8, Degree=3, Periodic=False, KnotStyle=1)  # -> Curve, Length, Domain
curve_8 = Curve(interpolate_8.Curve)

# ---- group: shifting
# shifting
t_9 = Slider(2, range=0..10)
c_3 = Slider(1.5, range=0..10)
# scaling
d_3 = Slider(1, range=0..10)
pi_9 = Pi(Factor=t_9)
range_9 = Range(Domain=pi_9, Steps="200")
subtraction_2 = Subtraction(A=range_9, B=c_3)
sine_6 = Sine(Value=subtraction_2)
addition_2 = Addition(A=sine_6, B=d_3)
construct_point_9 = ConstructPoint(XCoordinate=range_9, YCoordinate=addition_2, ZCoordinate=0)
interpolate_9 = Interpolate(Vertices=construct_point_9, Degree=3, Periodic=False, KnotStyle=1)  # -> Curve, Length, Domain
curve_9 = Curve(interpolate_9.Curve)

# ---- group: scaling
t_10 = Slider(2, range=0..10)
e = Slider(0.5, range=-2..2)
pi_10 = Pi(Factor=t_10)
range_10 = Range(Domain=pi_10, Steps="200")
sine_7 = Sine(Value=range_10)
multiplication_5 = Multiplication(A=range_10, B=e)
multiplication_6 = Multiplication(A=sine_7, B=e)
construct_point_10 = ConstructPoint(XCoordinate=multiplication_5, YCoordinate=multiplication_6, ZCoordinate=0)
interpolate_10 = Interpolate(Vertices=construct_point_10, Degree=3, Periodic=False, KnotStyle=1)  # -> Curve, Length, Domain
curve_10 = Curve(interpolate_10.Curve)

# ---- group: cutting
# cutting
t_11 = Slider(1, range=0..10)
pi_11 = Pi(Factor=t_11)
range_11 = Range(Domain=pi_11, Steps="200")
sine_8 = Sine(Value=range_11)
construct_point_11 = ConstructPoint(XCoordinate=range_11, YCoordinate=sine_8, ZCoordinate=0)
interpolate_11 = Interpolate(Vertices=construct_point_11, Degree=3, Periodic=False, KnotStyle=1)  # -> Curve, Length, Domain
curve_11 = Curve(interpolate_11.Curve)

# ---- group: dampening
# dampening
t_12 = Slider(2, range=0..10)
f = Slider(0.25, range=0..1)
pi_12 = Pi(Factor=t_12)
negative = Negative(Value=f)
range_12 = Range(Domain=pi_12, Steps="200")
sine_9 = Sine(Value=range_12)
multiplication_7 = Multiplication(A=range_12, B=negative)
power_of_e = PowerOfE(Value=multiplication_7)
multiplication_8 = Multiplication(A=sine_9, B=power_of_e)
construct_point_12 = ConstructPoint(XCoordinate=range_12, YCoordinate=multiplication_8, ZCoordinate=0)
interpolate_12 = Interpolate(Vertices=construct_point_12, Degree=3, Periodic=False, KnotStyle=1)  # -> Curve, Length, Domain
curve_12 = Curve(interpolate_12.Curve)

# ---- group: dampening expression
# dampening expression
t_13 = Slider(4, range=0..10)
a_4 = Slider(2, range=0..10)
b_4 = Slider(2, range=0..10)
f_2 = Slider(0.25, range=0..1)
pi_13 = Pi(Factor=t_13)
range_13 = Range(Domain=pi_13, Steps="400")
expression_3 = Expression(x=range_13, a=a_4, b=b_4, f=f_2, Expression="a*sin(b*x)*e^(-f*x)")
construct_point_13 = ConstructPoint(XCoordinate=range_13, YCoordinate=expression_3, ZCoordinate=0)
interpolate_13 = Interpolate(Vertices=construct_point_13, Degree=3, Periodic=False, KnotStyle=1)  # -> Curve, Length, Domain
curve_13 = Curve(interpolate_13.Curve)

# ---- group: dampening series
# dampened series
t_14 = Slider(4, range=0..10)
a_5 = Slider(2, range=0..10)
b_5 = Slider(2, range=0..10)
start = Slider(0.1, range=0..1)
step = Slider(0.05, range=0..1)
count = Slider(5, range=0..100)
pi_14 = Pi(Factor=t_14)
series = Series(Start=start, Step=step, Count=count)  # -> graft(Series)
range_14 = Range(Domain=pi_14, Steps="400")
expression_4 = Expression(x=range_14, a=a_5, b=b_5, f=series, Expression="a*sin(b*x)*e^(-f*x)")
construct_point_14 = ConstructPoint(XCoordinate=range_14, YCoordinate=expression_4, ZCoordinate=0)
interpolate_14 = Interpolate(Vertices=construct_point_14, Degree=3, Periodic=False, KnotStyle=1)  # -> flatten(Curve), Length, Domain
curve_14 = Curve(interpolate_14.Curve)

# ---- group: texturing
# texturing
t_15 = Slider(2, range=0..10)
a_6 = Slider(0.5, range=0..10)
pi_15 = Pi(Factor=t_15)
range_15 = Range(Domain=pi_15, Steps="200")
expression_5 = Expression(x=range_15, a=a_6, Expression="a*sin(a^-1*x)+sin(x)")
construct_point_15 = ConstructPoint(XCoordinate=range_15, YCoordinate=expression_5, ZCoordinate=0)
interpolate_15 = Interpolate(Vertices=construct_point_15, Degree=3, Periodic=False, KnotStyle=1)  # -> Curve, Length, Domain
curve_15 = Curve(interpolate_15.Curve)

# ---- group: textured series
# textured series
t_16 = Slider(2, range=0..10)
start_2 = Slider(0.1, range=0..1)
step_2 = Slider(0.1, range=0..1)
count_2 = Slider(5, range=0..10)
series_2 = Series(Start=start_2, Step=step_2, Count=count_2)  # -> graft(Series)
pi_16 = Pi(Factor=t_16)
range_16 = Range(Domain=pi_16, Steps="200")
expression_6 = Expression(x=range_16, a=series_2, Expression="a*sin(a^-1*x)+sin(x)")
construct_point_16 = ConstructPoint(XCoordinate=range_16, YCoordinate=expression_6, ZCoordinate=0)
interpolate_16 = Interpolate(Vertices=construct_point_16, Degree=3, Periodic=False, KnotStyle=1)  # -> Curve, Length, Domain
curve_16 = Curve(interpolate_16.Curve)
