# Grasshopper definition wave-attractor.gh (Grasshopper 1.0.7)
# Copyright: GNU General Public License 3.0

# ---- group: dampened sinusoidal wave
# wave attractor
# dampened sinusoidal wave
t = Slider(2, range=0..10)
a = Slider(0.3, range=0..6)
b = Slider(4, range=0..6)
c = Slider(0, range=0..6)
d = Slider(0, range=0..6)
pi = Pi(Factor=t)
range = Range(Domain=pi, Steps="200")
expression = Expression(x=range, a=a, b=b, c=c, d=d, Expression="a*sin(b*x-c)+d")
construct_point = ConstructPoint(XCoordinate=range, YCoordinate=expression, ZCoordinate=0)
point = Point(construct_point)

# ---- group: attractor
# attractor
panel = Panel("0,-2.25,0")
cellsize = Slider(0.1, range=0..1)
extent = Slider(40, range=0..1000)
extent_2 = Slider(30, range=0..1000)
point_2 = Point(point)
# styling
threshold = Slider(0.4, range=0..1)
hexagonal = Hexagonal(Plane=panel, Size=cellsize, ExtentX=extent, ExtentY=extent_2)  # -> flatten(Cells), flatten(Points)
closest_point = ClosestPoint(Point=hexagonal.Points, Cloud=point_2)  # -> ClosestPoint, CPIndex, Distance
bounds = Bounds(Numbers=closest_point.Distance)
remap_numbers = RemapNumbers(Value=closest_point.Distance, Source=bounds, Target="0.85 To 0.1")  # -> Mapped, Clipped
graph_mapper = GraphMapper(remap_numbers.Mapped, x0=0, x1=1, y0=0, y1=1, container_name="Bezier", cpx=[0, 1, 0.4995577037, 1], cpy=[0, 0, 1, 1])
larger_than = LargerThan(FirstNumber=graph_mapper, SecondNumber=threshold)  # -> LargerThan, OrEqualTo
scale = Scale(Geometry=hexagonal.Cells, Center=hexagonal.Points, Factor=graph_mapper)  # -> Geometry, Transform
cull_pattern = CullPattern(List=scale.Geometry, CullPattern=larger_than.LargerThan)
curve = Curve(cull_pattern)

# ---- group: styling
curve_2 = Curve(curve)
threshold_2 = Number(threshold)
remapped = Number(remap_numbers.Mapped)
boolean = Boolean(larger_than.LargerThan)
boundary_surfaces = BoundarySurfaces(Edges=curve_2)
cull_pattern_2 = CullPattern(List=remapped, CullPattern=boolean)
gradient = Gradient(LowerLimit=threshold_2, UpperLimit=1, Parameter=cull_pattern_2, stops=[0: RGB(255, 255, 255), 1: RGB(0, 0, 0)])
custom_preview = CustomPreview(Geometry=boundary_surfaces, Material=gradient)
