# Grasshopper definition fast-noise.gh (Grasshopper 1.0.7)
# Copyright: GNU General Public License 3.0
# plug-ins: BitmapPlus

# ---- group: generate procedural noise
# fast noise
# with
# bitmap+
# procedural noise
seed = Slider(0, range=0..100)
width = Slider(100, range=0..100)
height = Slider(100, range=0..100)
depth = Slider(5000, range=0..10000)
list = ValueList({"Value": 0, "Perlin": 1, "Cubic": 2, "Simplex": 3, "WhiteNoise": 4}, selected="Perlin")
list_2 = ValueList({"Linear": 0, "Hermite": 1, "Quintic": 2}, selected="Hermite")
frequency = Slider(0.094, range=0..0.1)
procedural_noise = ProceduralNoise(Seed=seed, Width=width, Height=height, Depth=depth, Mode=list, Interpolation=list_2, Frequency=frequency)  # -> Image, Noise
prev_image = PrevImage(SmartBitmap=procedural_noise.Image)
image = Data(procedural_noise.Image)

# ---- group: generate cellular noise
# cellular noise
seed_2 = Slider(4, range=0..100)
width_2 = Slider(100, range=0..100)
height_2 = Slider(100, range=0..100)
depth_2 = Slider(39, range=0..500)
list_3 = ValueList({"Euclidean": 0, "Manhattan": 1, "Natural": 2}, selected="Euclidean")
list_4 = ValueList({"Value": 0, "Distance2": 2, "Dist2Add": 3, "Dist2Sub": 4, "Dist2Mul": 5, "Dist2Div": 6}, selected="Dist2Div")
procedural_cellular = ProceduralCellular(
    Seed=seed_2,
    Width=width_2,
    Height=height_2,
    Depth=depth_2,
    BoundaryMode=list_3,
    InterpolationMode=list_4,
    Jitter=Slider(0.5, range=0..1),
    Frequency=Slider(0.085, range=0..1))
prev_image_2 = PrevImage(SmartBitmap=procedural_cellular)
image_2 = Data(procedural_cellular)

# ---- group: construct grid
image_3 = Data(image_2)
# construct grid
bitmap_properties = BitmapProperties(Image=image_3)  # -> Boundary, Width, Height, HorizontalResolution, VerticalResolution, Format
mesh_plane = MeshPlane(
    Boundary=bitmap_properties.Boundary,
    WidthCount=expr("x-1", bitmap_properties.Width),
    HeightCount=expr("x-1", bitmap_properties.Height))  # -> Mesh, Area
deconstruct_mesh = DeconstructMesh(Mesh=mesh_plane.Mesh)  # -> Vertices, Faces, Colours, Normals
mesh_face = MeshFace(deconstruct_mesh.Faces)
point = Point(deconstruct_mesh.Vertices)

# ---- group: extract noise
image_4 = Data(image_2)
# extract noise
deconstruct_bitmap = DeconstructBitmap(Image=image_4)
split_ahsv = SplitAHSV(Colour=deconstruct_bitmap)  # -> Alpha, Hue, Saturation, Value
noise = Number(split_ahsv.Value)

# ---- group: construct mesh
# 3D mesh
point_2 = Point(point)
mesh_face_2 = MeshFace(mesh_face)
z_factor = Slider(6, range=0..10)
noise_2 = Number(noise)
multiplication = Multiplication(A=z_factor, B=noise_2)
unit_z = UnitZ(Factor=multiplication)
gradient = Gradient(
    LowerLimit=0,
    UpperLimit=1,
    Parameter=noise_2,
    stops=[0: RGB(68, 1, 84), 0.167: RGB(68, 57, 131), 0.334: RGB(49, 104, 142), 0.501: RGB(33, 145, 140), 0.668: RGB(53, 183, 121), 0.835: RGB(144, 215, 67), 1: RGB(253, 231, 37)])
move = Move(Geometry=point_2, Motion=unit_z)  # -> Geometry, Transform
construct_mesh = ConstructMesh(Vertices=move.Geometry, Faces=mesh_face_2, Colours=gradient)
mesh = Mesh(construct_mesh)

# ---- group: compute contours
# contours
mesh_2 = Mesh(mesh)
interval = Slider(0.2, range=0..1)
contour = Contour(Shape=mesh_2, Point=Point(0, 0, 0), Direction=Vector(0, 0, 1), Distance=interval)
custom_preview = CustomPreview(Geometry=contour, Material=ColourSwatch(SwatchColor=RGB(255, 255, 255)))
