# Grasshopper definition biome.gh (Grasshopper 1.0.7)
# Copyright: GNU General Public License 3.0
# plug-ins: BitmapPlus, Kangaroo2 Components

# ---- group: procedural noise
# biomes
# terrain
# procedural noise
# with bitmap+
seed = Slider(4, range=0..100)
width = Slider(36, range=0..100)
height = Slider(36, range=0..100)
depth = Slider(39, range=0..500)
list = ValueList({"Euclidean": 0, "Manhattan": 1, "Natural": 2}, selected="Euclidean")
list_2 = ValueList({"Value": 0, "Distance2": 2, "Dist2Add": 3, "Dist2Sub": 4, "Dist2Mul": 5, "Dist2Div": 6}, selected="Dist2Div")
# construct grid
number_slider = Slider(0.09, range=0..1)
procedural_cellular = ProceduralCellular(
    Seed=seed,
    Width=width,
    Height=height,
    Depth=depth,
    BoundaryMode=list,
    InterpolationMode=list_2,
    Jitter=Slider(0.5, range=0..1),
    Frequency=number_slider)
image = Data(procedural_cellular)

# ---- group: construct grid
# extract noise
image_2 = Data(image)
bitmap_properties = BitmapProperties(Image=image_2)  # -> Boundary, Width, Height, HorizontalResolution, VerticalResolution, Format
mesh_plane = MeshPlane(
    Boundary=bitmap_properties.Boundary,
    WidthCount=expr("x-1", bitmap_properties.Width),
    HeightCount=expr("x-1", bitmap_properties.Height))  # -> Mesh, Area
deconstruct_mesh = DeconstructMesh(Mesh=mesh_plane.Mesh)  # -> Vertices, Faces, Colours, Normals
mesh_face = MeshFace(deconstruct_mesh.Faces)
point = Point(deconstruct_mesh.Vertices)

# ---- group: extract noise
image_3 = Data(image)
deconstruct_bitmap = DeconstructBitmap(Image=image_3)
split_ahsv = SplitAHSV(Colour=deconstruct_bitmap)  # -> Alpha, Hue, Saturation, Value
noise = Number(split_ahsv.Value)

# ---- group: construct mesh
# mesh
point_2 = Point(point)
mesh_face_2 = MeshFace(mesh_face)
z_factor = Slider(6, range=0..10)
noise_2 = Number(noise)
multiplication = Multiplication(A=z_factor, B=noise_2)
unit_z = UnitZ(Factor=multiplication)
gradient = Gradient(
    LowerLimit=0,
    UpperLimit=1,
    Parameter=noise_2,
    stops=[0: RGB(55, 11, 65), 0.125: RGB(27, 30, 59), 0.25: RGB(22, 83, 76), 0.375: RGB(68, 119, 49), 0.5: RGB(161, 121, 74), 0.625: RGB(212, 132, 169), 0.75: RGB(198, 180, 238), 0.875: RGB(203, 232, 240), 1: RGB(255, 255, 255)])
move = Move(Geometry=point_2, Motion=unit_z)  # -> Geometry, Transform
construct_mesh = ConstructMesh(Vertices=move.Geometry, Faces=mesh_face_2, Colours=gradient)
point_3 = Point(move.Geometry)
mesh = Mesh(construct_mesh)

# ---- group: lowpoly tree
# planting
# tree
trunk_height = Slider(0.7, range=0..4)
trunk_radius = Slider(0.07, range=0..1)
tree_height = Slider(3, range=0..4)
divisions = Slider(3, range=0..10)
# gradient
canopy_radius = Slider(0.7, range=0..4)
lowpoly_tree = LowpolyTree(trunk_height=trunk_height, relay=trunk_radius, A=tree_height, relay_2=divisions, relay_3=canopy_radius)  # -> pipe_2, result
trunks = Brep(lowpoly_tree.pipe_2)
canopy = Brep(lowpoly_tree.result)

# ---- group: gradient
point_4 = Point(point_3)
noise_3 = Number(noise)
threshold = Slider(0.2, range=0..1)
smaller_than = SmallerThan(FirstNumber=noise_3, SecondNumber=threshold)  # -> SmallerThan, OrEqualTo
cull_pattern = CullPattern(List=point_4, CullPattern=smaller_than.OrEqualTo)
cull_pattern_2 = CullPattern(List=noise_3, CullPattern=smaller_than.OrEqualTo)
number = Number(cull_pattern_2)
point_5 = Point(cull_pattern)

# ---- group: decimate
# decimation
point_6 = Point(point_5)
number_2 = Number(number)
# jitter
reduction = Slider(0.4, range=0..1)
list_length = ListLength(List=point_6)
multiplication_2 = Multiplication(A=list_length, B=reduction)
reduce = RandomReduce(List=point_6, Reduction=multiplication_2, Seed=1)
reduce_2 = RandomReduce(List=number_2, Reduction=multiplication_2, Seed=1)
number_3 = Number(reduce_2)
point_7 = Point(reduce)

# ---- group: jitter
point_8 = Point(point_7)
deconstruct = Deconstruct(Point=point_8)  # -> XComponent, YComponent, ZComponent
list_length_2 = ListLength(List=point_8)
random = Random(Range="-1 To 1", Number=list_length_2, Seed=2)
addition = Addition(A=deconstruct.XComponent, B=random)
addition_2 = Addition(A=deconstruct.YComponent, B=random)
construct_point = ConstructPoint(XCoordinate=addition, YCoordinate=addition_2, ZCoordinate=deconstruct.ZComponent)
point_9 = Point(construct_point)

# ---- group: snap
# snap
point_10 = Point(point_9)
mesh_2 = Mesh(mesh)
onmesh = OnMesh(Points=point_10, Mesh=mesh_2, Strength=1)
zombiesolver = ZombieSolver(GoalObjects=onmesh, Threshold=1e-10, Tolerance=0.0001, MaxIterations="1")  # -> I, V, O
point_11 = Point(zombiesolver.V)

# ---- group: scatter
# distribute trees
trunks_2 = Brep(trunks)
canopy_2 = Brep(canopy)
point_12 = Point(point_11)
number_4 = Number(number_3)
move_2 = Move(Geometry=trunks_2, Motion=point_12)  # -> Geometry, Transform
move_3 = Move(Geometry=canopy_2, Motion=point_12)  # -> Geometry, Transform
bounds = Bounds(Numbers=number_4)
remap_numbers = RemapNumbers(Value=number_4, Source=bounds, Target="1 To 0.5")  # -> Mapped, Clipped
scale = Scale(Geometry=move_3.Geometry, Center=point_12, Factor=remap_numbers.Mapped)  # -> Geometry, Transform
trunk_color = ColourSwatch(SwatchColor=RGB(139, 76, 57))
custom_preview = CustomPreview(Geometry=move_2.Geometry, Material=trunk_color)
canopy_3 = Brep(scale.Geometry)

# ---- group: color gradient
# color gradient
canopy_4 = Brep(canopy_3)
number_5 = Number(number_3)
bounds_2 = Bounds(Numbers=number_5)
remap_numbers_2 = RemapNumbers(Value=number_5, Source=bounds_2, Target=Domain(0, 1))  # -> Mapped, Clipped
gradient_2 = Gradient(
    LowerLimit=0,
    UpperLimit=1,
    Parameter=remap_numbers_2.Mapped,
    stops=[0: RGB(50, 84, 84), 0.5: RGB(80, 153, 114), 1: RGB(76, 84, 45)])
custom_preview_2 = CustomPreview(Geometry=canopy_4, Material=gradient_2)

# ==== cluster LowpolyTree
trunk_height = ClusterInput()
relay = ClusterInput()
A = ClusterInput()
relay_2 = ClusterInput()
relay_3 = ClusterInput()
unit_z = UnitZ(Factor=trunk_height)
subtraction = Subtraction(A=A, B=trunk_height)
move = Move(Geometry="0,0,0", Motion=unit_z)  # -> Geometry, Transform
top_of_trunk = Point(move.Geometry)
unit_z_2 = UnitZ(Factor=subtraction)
division = Division(A=subtraction, B=relay_2)
move_2 = Move(Geometry=top_of_trunk, Motion=unit_z_2)  # -> Geometry, Transform
line = Line(StartPoint="0,0,0", EndPoint=move.Geometry)
line_2 = Line(StartPoint=top_of_trunk, EndPoint=move_2.Geometry)
pipe = Pipe(Curve=line, Radius=relay, Caps="1")
divide_curve = DivideCurve(Curve=line_2, Count=relay_2, Kinks=False)  # -> Points, Tangents, Parameters
pipe_2 = ClusterOutput(pipe)
split_list = SplitList(List=divide_curve.Points, Index=relay_2)  # -> ListA, ListB
range = Range(Domain="1 To 0.5", Steps=expr("x-1", relay_2))
cone = Cone(Base=split_list.ListA, Radius=relay_3, Length=division)  # -> Cone, Tip
multiplication = Multiplication(A=range, B="2")
scale_nu = ScaleNU(Geometry=cone.Cone, Plane=split_list.ListA, ScaleX=range, ScaleY=range, ScaleZ=multiplication)  # -> Geometry, Transform
cap_holes = CapHoles(Brep=scale_nu.Geometry)
solid_union = SolidUnion(Breps=cap_holes)
result = ClusterOutput(solid_union)
