# Grasshopper definition lowpoly-tree.gh (Grasshopper 1.0.8)
# Copyright: GNU General Public License 3.0

# ---- group: trunk
# lowpoly tree
# trunk
panel = Panel("0,0,0")
trunk_height = Slider(5, range=0..100)
# divisions
trunk_radius = Slider(0.5, range=0..1)
unit_z = UnitZ(Factor=trunk_height)
point = Point(panel)
move = Move(Geometry=point, Motion=unit_z)  # -> Geometry, Transform
line = Line(StartPoint=point, EndPoint=move.Geometry)
pipe = Pipe(Curve=line, Radius=trunk_radius, Caps="1")
trunk = Brep(pipe)

# ---- group: canopy divisions
top_of_trunk = Point(move.Geometry)
tree_height = Slider(20, range=0..100)
trunk_height_2 = Number(trunk_height)
# canopy
divisions = Slider(3, range=3..10)
subtraction = Subtraction(A=tree_height, B=trunk_height_2)
unit_z_2 = UnitZ(Factor=subtraction)
division = Division(A=subtraction, B=divisions)
move_2 = Move(Geometry=top_of_trunk, Motion=unit_z_2)  # -> Geometry, Transform
line_2 = Line(StartPoint=top_of_trunk, EndPoint=move_2.Geometry)
divide_curve = DivideCurve(Curve=line_2, Count=divisions, Kinks=False)  # -> Points, Tangents, Parameters
split_list = SplitList(List=divide_curve.Points, Index=divisions)  # -> ListA, ListB
divisions_2 = Number(divisions)
point_2 = Point(split_list.ListA)
length = Number(division)

# ---- group: canopy
canopy_radius = Slider(5, range=0..10)
length_2 = Number(length)
point_3 = Point(point_2)
# cluster
divisions_3 = Number(divisions_2)
range = Range(Domain="1 To 0.5", Steps=expr("x-1", divisions_3))
cone = Cone(Base=point_3, Radius=canopy_radius, Length=length_2)  # -> Cone, Tip
scale_nu = ScaleNU(Geometry=cone.Cone, Plane=point_3, ScaleX=range, ScaleY=range, ScaleZ=expr("x*2", range))  # -> Geometry, Transform
cap_holes = CapHoles(Brep=scale_nu.Geometry)
solid_union = SolidUnion(Breps=cap_holes)
canopy = Brep(solid_union)

# ---- group: cluster
trunk_height_3 = Slider(5, range=0..100)
trunk_radius_2 = Slider(0.5, range=0..1)
tree_height_2 = Slider(20, range=0..100)
divisions_4 = Slider(3, range=0..10)
canopy_radius_2 = Slider(5, range=0..10)
lowpoly_tree = LowpolyTree(trunk_height=trunk_height_3, relay=trunk_radius_2, A=tree_height_2, relay_2=divisions_4, relay_3=canopy_radius_2)  # -> pipe_2, result
trunk_color = ColourSwatch(SwatchColor=RGB(139, 76, 57))
canopy_color = ColourSwatch(SwatchColor=RGBA(58, 94, 84, 232))
custom_preview = CustomPreview(Geometry=lowpoly_tree.pipe_2, Material=trunk_color)
custom_preview_2 = CustomPreview(Geometry=lowpoly_tree.result, Material=canopy_color)

# ==== cluster LowpolyTree
trunk_height = ClusterInput()
relay = ClusterInput()
A = ClusterInput()
relay_2 = ClusterInput()
relay_3 = ClusterInput()
unit_z = UnitZ(Factor=trunk_height)
subtraction = Subtraction(A=A, B=trunk_height)
point = Point("0,0,0")
move = Move(Geometry=point, Motion=unit_z)  # -> Geometry, Transform
top_of_trunk = Point(move.Geometry)
unit_z_2 = UnitZ(Factor=subtraction)
division = Division(A=subtraction, B=relay_2)
move_2 = Move(Geometry=top_of_trunk, Motion=unit_z_2)  # -> Geometry, Transform
line = Line(StartPoint=point, EndPoint=move.Geometry)
line_2 = Line(StartPoint=top_of_trunk, EndPoint=move_2.Geometry)
pipe = Pipe(Curve=line, Radius=relay, Caps="1")
divide_curve = DivideCurve(Curve=line_2, Count=relay_2, Kinks=False)  # -> Points, Tangents, Parameters
pipe_2 = ClusterOutput(pipe)
split_list = SplitList(List=divide_curve.Points, Index=relay_2)  # -> ListA, ListB
range = Range(Domain="1 To 0.5", Steps=expr("x-1", relay_2))
cone = Cone(Base=split_list.ListA, Radius=relay_3, Length=division)  # -> Cone, Tip
multiplication = Multiplication(A=range, B="2")
scale_nu = ScaleNU(Geometry=cone.Cone, Plane=split_list.ListA, ScaleX=range, ScaleY=range, ScaleZ=multiplication)  # -> Geometry, Transform
cap_holes = CapHoles(Brep=scale_nu.Geometry)
solid_union = SolidUnion(Breps=cap_holes)
result = ClusterOutput(solid_union)
