# Grasshopper definition white-sands.gh (Grasshopper 1.0.7)
# Copyright: GNU General Public License 3.0

# ---- group: decimate
# white sands
# decimation
point = Point()
list_length = ListLength(List=point)
division = Division(A=list_length, B="4")
subtraction = Subtraction(A=list_length, B=division)
random_reduce = RandomReduce(List=point, Reduction=subtraction, Seed=1)
point_2 = Point(random_reduce)

# ---- group: triangulate
# mesh
point_3 = Point(point_2)
delaunay_mesh = DelaunayMesh(Points=point_3, Plane=PlaneXY(0, 0, 0))
deconstruct_mesh = DeconstructMesh(Mesh=delaunay_mesh)  # -> Vertices, Faces, Colours, Normals
deconstruct = Deconstruct(Point=deconstruct_mesh.Vertices)  # -> XComponent, YComponent, ZComponent
bounds = Bounds(Numbers=deconstruct.ZComponent)
remap_numbers = RemapNumbers(Value=deconstruct.ZComponent, Source=bounds, Target=Domain(0, 1))  # -> Mapped, Clipped
gradient = Gradient(
    LowerLimit=0,
    UpperLimit=1,
    Parameter=remap_numbers.Mapped,
    stops=[0: RGB(225, 216, 226), 0.1: RGB(165, 191, 202), 0.2: RGB(109, 144, 191), 0.3: RGB(94, 87, 176), 0.4: RGB(83, 29, 124), 0.5: RGB(47, 20, 54), 0.6: RGB(99, 24, 75), 0.7: RGB(158, 59, 79), 0.8: RGB(192, 116, 93), 0.9: RGB(208, 178, 158), 1: RGB(225, 216, 225)])
construct_mesh = ConstructMesh(Vertices=deconstruct_mesh.Vertices, Faces=deconstruct_mesh.Faces, Colours=gradient)
mesh = Mesh(construct_mesh)
