# Grasshopper definition cut-fill-operations.gh (Grasshopper 1.0.7)
# Copyright: GNU General Public License 3.0
# plug-ins: Docofossor

# ---- group: generate distance field
size = Slider(1, range=0..10)
extent = Slider(100, range=0..500)
square = Square(Plane=PlaneXY(0, 0, 0), Size=size, ExtentX=extent, ExtentY=extent)  # -> Cells, flatten(Points)
import_points = ImportPoints(Pts=square.Points)
grid_mesh = GridMesh(Df=import_points)
data = Data(import_points)
custom_preview = CustomPreview(Geometry=grid_mesh, Material=ColourSwatch(SwatchColor=RGB(217, 217, 217)))

# ---- group: set low point
# cut and fill
# with docofossor
# geometry
# distance field
point = Point(Point(50, 50, -15))

# ---- group: cut in point
# cut in point
data_2 = Data(data)
point_2 = Point(point)
slope = Slider(30, range=0..100)
distance = Slider(90, range=0..100)
cut_in_point = CutInPoint(Df=data_2, Pt=point_2, Sa=slope, D=distance)  # -> Df, Vol
grid_mesh_2 = GridMesh(Df=cut_in_point.Df)
custom_preview_2 = CustomPreview(Geometry=grid_mesh_2, Material=ColourSwatch(SwatchColor=RGB(217, 217, 217)))

# ---- group: cut on point
# cut on point
data_3 = Data(data)
point_3 = Point(point)
depth = Slider(10, range=0..100)
# fill on point
slope_2 = Slider(24, range=0..100)
cut_on_point = CutOnPoint(Df=data_3, Pt=point_3, Mxd=depth, Sa=slope_2)  # -> Df, Vol
grid_mesh_3 = GridMesh(Df=cut_on_point.Df)
custom_preview_3 = CustomPreview(Geometry=grid_mesh_3, Material=ColourSwatch(SwatchColor=RGB(217, 217, 217)))

# ---- group: fill on point
data_4 = Data(data)
point_4 = Point(point)
depth_2 = Slider(10, range=0..100)
slope_3 = Slider(24, range=0..100)
fill_on_point = FillOnPoint(Df=data_4, Pt=point_4, Mxh=depth_2, Sa=slope_3)  # -> Df, Vol
grid_mesh_4 = GridMesh(Df=fill_on_point.Df)
custom_preview_4 = CustomPreview(Geometry=grid_mesh_4, Material=ColourSwatch(SwatchColor=RGB(217, 217, 217)))

# ---- group: set high point
point_5 = Point(Point(50, 50, 15))

# ---- group: fill in point
# fill in point
data_5 = Data(data)
point_6 = Point(point_5)
slope_4 = Slider(33, range=0..100)
distance_2 = Slider(90, range=0..100)
fill_in_point = FillInPoint(Df=data_5, Pt=point_6, Sa=slope_4, D=distance_2)  # -> Df, Vol
grid_mesh_5 = GridMesh(Df=fill_in_point.Df)
custom_preview_5 = CustomPreview(Geometry=grid_mesh_5, Material=ColourSwatch(SwatchColor=RGB(217, 217, 217)))

# ---- group: set 3D curve
curve = Curve(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)

# ---- group: cut-fill in path
# cut-fill in path
data_6 = Data(data)
curve_2 = Curve(curve)
width = Slider(5, range=0..10)
slope_5 = Slider(33, range=0..100)
# cut on path
distance_3 = Slider(50, range=0..100)
cut_fill_in_path = CutFillInPath(Df=data_6, Crv=curve_2, W=width, Sa=slope_5, D=distance_3)  # -> Df, Vol
grid_mesh_6 = GridMesh(Df=cut_fill_in_path.Df)
custom_preview_6 = CustomPreview(Geometry=grid_mesh_6, Material=ColourSwatch(SwatchColor=RGB(217, 217, 217)))

# ---- group: set 2D curve
curve_3 = Curve(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)

# ---- group: cut on path
data_7 = Data(data)
curve_4 = Curve(curve_3)
height = Slider(10, range=0..100)
width_2 = Slider(10, range=0..10)
slope_6 = Slider(24, range=0..100)
# fill on path
distance_4 = Slider(50, range=0..100)
cut_on_path = CutOnPath(Df=data_7, Crv=curve_4, Mxd=height, Wb=width_2, Sa=slope_6, D=distance_4)  # -> Df, Vol
grid_mesh_7 = GridMesh(Df=cut_on_path.Df)
custom_preview_7 = CustomPreview(Geometry=grid_mesh_7, Material=ColourSwatch(SwatchColor=RGB(217, 217, 217)))

# ---- group: fill on path
data_8 = Data(data)
curve_5 = Curve(curve_3)
height_2 = Slider(10, range=0..100)
width_3 = Slider(10, range=0..10)
slope_7 = Slider(24, range=0..100)
distance_5 = Slider(50, range=0..100)
fill_on_path = FillOnPath(Df=data_8, Crv=curve_5, Mxh=height_2, Wt=width_3, Sa=slope_7, D=distance_5)  # -> Df, Vol
grid_mesh_8 = GridMesh(Df=fill_on_path.Df)
custom_preview_8 = CustomPreview(Geometry=grid_mesh_8, Material=ColourSwatch(SwatchColor=RGB(217, 217, 217)))
