# Grasshopper definition color-gradient.gh (Grasshopper 1.0.7)
# Copyright: GNU General Public License 3.0

# ---- group: color gradient
# color gradient
count = Slider(10, range=0..100)
square = Square(Plane=PlaneXY(0, 0, 0), Size=1, ExtentX=count, ExtentY="1")  # -> flatten(Cells), Points
range = Range(Domain=Domain(0, 1), Steps=count)
boundary = BoundarySurfaces(Edges=square.Cells)
gradient = Gradient(
    LowerLimit=0,
    UpperLimit=1,
    Parameter=range,
    stops=[0: RGB(68, 1, 84), 0.167: RGB(68, 57, 131), 0.334: RGB(49, 104, 142), 0.501: RGB(33, 145, 140), 0.668: RGB(53, 183, 121), 0.835: RGB(144, 215, 67), 1: RGB(253, 231, 37)])
custom_preview = CustomPreview(Geometry=boundary, Material=gradient)
