# Grasshopper definition color-plus.gh (Grasshopper 1.0.7)
# Copyright: GNU General Public License 3.0
# plug-ins: ColorPlus

# ---- group: color+
# color maps
# with color+ plugin
collections = ValueList({"Known": 0, "System": 1, "Windows": 2, "Win8": 3, "Metro": 4, "Flat": 5, "Fluent": 6, "RAL": 7, "*Material": 8, "*Tailwind": 9, "*D3 Categorical": 10, "*D3 Seq. Single": 11, "*D3 Seq. Multiple": 12, "*D3 Seq. Spectrum": 13, "*D3 Diverging": 14, "*D3 Cyclical": 15}, selected="*D3 Seq. Spectrum")
sub_collection = ValueList({"1", "2", "3", "4", "5", "6", "7", "8", "9", "10", "11", "12"}, selected="1")
samples = Slider(10, range=0..100)
color_palettes = ColorPalettes(Collection=collections, SubCollection=sub_collection)  # -> Names, Colors
range = Range(Domain=Domain(0, 1), Steps=samples)
construct_gradient = ConstructGradient(Colors=color_palettes.Colors, Sample=range, InterpolationMode=0)
preview_colors = PreviewColors(Colors=construct_gradient, Height=26, Label=False, Width=100)
