# Grasshopper definition relative-path.gh (Grasshopper 1.0.7)
# Copyright: GNU General Public License 3.0
# plug-ins: RhinoCodePluginGH

# ----
# relative path
filename = Panel("file.txt")
relative_path = Script(Filename=filename)  # -> out, Path
# ---------- relative_path: Python ----------
"""
Set relative path in Grasshopper
"""

__author__ = "Brendan Harmon"
__copyright__ = "Copyright 2023, Brendan Harmon"
__email__ = "brendan.harmon@gmail.com"
__license__ = "MIT"
__version__ = "1.0.0"

import pathlib
import os

# set path
filename = 'file.txt'
datapath = pathlib.Path(__file__).parent.absolute()
data = os.path.join(datapath, filename)
print(data)
# ---------- end relative_path ----------
file_path = FilePath(relative_path.Path)
